# Grasshopper definition MetaMAP_advanced_for_MACOS.ghx (Grasshopper 1.0.8)
# plug-ins: MetaMAP

# ---- group: Define it manually
panel = Panel("41.041122")
panel_2 = Panel("28.989991")

# ----
number_slider = Slider(500, range=0..500)
metaupdate = MetaUPDATE(Update=Toggle(True))  # -> Status, YourVersion
metaterrain = MetaTERRAIN(Latitude=panel, Longitude=panel_2, Radius=number_slider, GridResolution=Slider(10, range=0..10))  # -> TerrainBrep, ElevationPoints, ElevationValues, Status
panel_3 = Panel(metaupdate.Status)
metabuildingadvanced = MetaBuildingAdvanced(Latitude=panel, Longitude=panel_2, Radius=expr("x-100", number_slider), Terrain=metaterrain.TerrainBrep, Tiles="2")  # -> Buildings, DebugLog
panel_4 = Panel(metabuildingadvanced.DebugLog)
custom_preview = CustomPreview(Geometry=metabuildingadvanced.Buildings, Material=ColourSwatch(SwatchColor=RGB(255, 255, 255)))
custom_preview_2 = CustomPreview(Geometry=metaterrain.TerrainBrep, Material=ColourSwatch(SwatchColor=RGB(133, 133, 133)))
