# Grasshopper definition MetaMAP_basic_for_MACOS.ghx (Grasshopper 1.0.8)
# plug-ins: MetaMAP

number_slider = Slider(350, range=0..500)

# ---- group: Define it manually
latitude = Panel("41.041122")
longitude = Panel("28.989991")

# ----
metaupdate = MetaUPDATE(Update=Toggle(True))  # -> Status, YourVersion
metaterrain = MetaTERRAIN(Latitude=latitude, Longitude=longitude, Radius=number_slider, GridResolution="5")  # -> TerrainBrep, ElevationPoints, ElevationValues, Status
panel = Panel(metaupdate.Status)
metabuilding = MetaBuilding(Latitude=latitude, Longitude=longitude, Radius=expr("x-100", number_slider), Terrain=metaterrain.TerrainBrep)  # -> BuildingBreps, BuildingHeights, Status
panel_2 = Panel(metabuilding.Status)
custom_preview = CustomPreview(Geometry=metaterrain.TerrainBrep, Material=ColourSwatch(SwatchColor=RGB(133, 133, 133)))
custom_preview_2 = CustomPreview(Geometry=metabuilding.BuildingBreps, Material=ColourSwatch(SwatchColor=RGB(255, 255, 255)))
